# Grasshopper definition CustomIteration.gh (Grasshopper 0.9.76)
# plug-ins: Python Interpreter, Kangaroo2 Components

crv = Curve(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)
explode = Explode(Curve=crv, Recursive=True)  # -> Segments, Vertices
direction = Direction(Line=explode.Segments, Strength=1)
show = Show(G=crv)

crv_2 = Curve(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)
explode_2 = Explode(Curve=crv_2, Recursive=True)  # -> Segments, Vertices
direction_2 = Direction(Line=explode_2.Segments, Strength=1)
show_2 = Show(G=crv_2)

entwine = Entwine(Branch00=[direction, show], Branch01=[direction_2, show_2], FlattenInputs=True)

# ----
# Custom iteration script using the solver library without the timer. Also note this creates separate solver instances for each branch of the data tree
python = PythonScript(x=entwine)  # -> out, A, B; inputs x: list
# ---------- python: Python ----------
"""
Solve Kangaroo2 goals using a custom iteration script ala Zombie mode.
Based on Daniel Pikers CustomIteration.gh definition.
-
Author: Anders Holden Deleuran
Github: github.com/AndersDeleuran/KangarooGHPython
Updated: 150502
"""

import clr
clr.AddReferenceToFile("KangarooSolver.dll")
import KangarooSolver as ks
from System.Collections.Generic import List

# Make solver system and goals list
ps = ks.PhysicalSystem()
goals = List[ks.IGoal]()
tol = 0.0001 # points closer than this will get combined into a single particle

# Assign indexes to the particles in each Goal
for g in x:
    ps.AssignPIndex(g,tol)
    goals.Add(g)

# System state variables
counter = 0
threshold = 1e-10

# Solve zombie style i.e. max N iterations, break when system kinetic energy drops below threshold
while counter < 100:
    ps.Step(goals,True,threshold)
    counter += 1
    if ps.GetvSum() < threshold:
        break

A = ps.GetOutput(goals)
B = counter
# ---------- end python ----------

bang = ExplodeTree(Data=python.A)  # -> Branch0, Branch1
preview = CustomPreview(Geometry=bang.Branch0, Shader=ColourSwatch(SwatchColor=RGB(255, 0, 0)))
preview_2 = CustomPreview(Geometry=bang.Branch1, Shader=ColourSwatch(SwatchColor=RGB(0, 0, 255)))
